test file "sltest_tut07_tests"
  coverage: Decision, MCDC, Condition

suite "New Test Suite 1"

  case "tut07_Harness1" [equivalence]
    simulation 1:
      model tut07, harness tut07_Harness1 (for tut07/Subsystem), mode Normal
      input "Test Case:1" from tut07_Harness2_sldvdata.mat
      input "Design Verifier (tut07_Harness2_sldvdata.mat)" from tut07_Harness2_sldvdata.mat
    simulation 2:
      model tut07, harness tut07_SIL (for tut07/Subsystem), mode Software-in-the-Loop (SIL)
      input "Test Case:1" from tut07_Harness2_sldvdata.mat
      input "Design Verifier (tut07_Harness2_sldvdata.mat)" from tut07_Harness2_sldvdata.mat
    iterations:
      Iteration1: ExternalInput "Test Case:1", ExternalInput "Test Case:1"

suite "New Test Suite 2"

  case "New Test Case 1" [simulation]